# Grasshopper definition Grids_LINK Example.gh (Grasshopper 1.0.7)
# Copyright: 2021
# plug-ins: HLADoodles

geo = Geometry([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])
grid = Grid(
    Geometry=geo,
    GridSize_m="10",
    VerticalOffset_m=0.75,
    EdgeOffset_m=0.5,
    IsoCurves=True,
    PerfectSquares=True,
    GoLarge=False)  # -> Grids, Mesh, Points
avr = Average(Input=flatten(grid.Points))
gradient = Gradient(LowerLimit="500", UpperLimit="1000", Parameter=1, stops=[0: RGB(0, 128, 0), 0.5: RGB(255, 255, 0), 1: RGB(255, 0, 0)])
dist = Distance(PointA=grid.Points, PointB=avr)
section_range = GH_SectionType_Range(From="0", To="1700", Steps=Slider(20, range=2..20))
bnd = Bounds(Numbers=flatten(dist))
panel = Panel(bnd)
gridviewer = GridViewer(
    Grids=grid.Grids,
    Results=dist,
    _Gradient=gradient,
    _MinColor=ColourSwatch(SwatchColor=RGB(212, 212, 212)),
    _MaxColor=ColourSwatch(SwatchColor=RGB(161, 161, 161)),
    _SectionType=section_range)  # -> ColoredMesh, LayeredMesh, Curves, Planes, TempMeshes, flatten(Colors), flatten(Values)
rec = Rectangle({Plane=PlaneXY(3393.090181, 1173.868077, 0), Size=Domain2(u=-662.5056981..662.5056981, v=-235.7033404..235.7033404)})
legend = Legend(Colour=flatten(gridviewer.Colors), Tags=flatten(gridviewer.Values), Rectangle=rec, LegendType=2)
crv = Curve(gridviewer.Curves)
mesh = Mesh(gridviewer.TempMeshes)
