# Grasshopper definition HLA_Doodles_Examples.gh (Grasshopper 1.0.7)
# Copyright: 2021
# plug-ins: HLADoodles

# Henning Larsen Architects
# (C) 2021
# Use at own risk!
# Still in testing mode
# 
# questions?
# Contact:
# Mikkel Esrup Steenberg or
# Mathias Sønderskov Schaltz
geo = Geometry([<curve referenced from the Rhino model> x2, <brep referenced from the Rhino model>])
gradient = Gradient(
    LowerLimit=0,
    UpperLimit=1,
    Parameter=1,
    stops=[0: RGB(234, 38, 0), 0.25: RGB(234, 126, 0), 0.5: RGB(254, 244, 84), 0.696: RGB(173, 203, 249), 0.986: RGB(75, 107, 169)])
Y = UnitY(Factor="-600")
Y_2 = UnitY(Factor="-300")
move = Move(Geometry=geo, Motion=Y)  # -> Geometry, Transform
move_2 = Move(Geometry=geo, Motion=Y_2)  # -> Geometry, Transform

# ----
# Still buggy
number_slider = Slider(27, range=5..50)
geo_2 = Geometry(<curve referenced from the Rhino model>)
grad = GradientParser(Gradient=gradient, Numbers=number_slider)
legend = Legend(Colour=grad, Tags=grad, Rectangle=geo_2, LegendType=1)

grid = Grid(
    Geometry=move.Geometry,
    GridSize_m=Slider(10, range=10..50),
    VerticalOffset_m=Slider(8, range=0..10),
    EdgeOffset_m=Slider(4, range=0..10),
    IsoCurves=Toggle(True),
    PerfectSquares=True)  # -> Grids, Mesh, Points
gradient_2 = Gradient(LowerLimit=0, UpperLimit=1, Parameter=1, stops=[0: RGB(255, 255, 255), 1: RGB(0, 0, 0)])

# ----
# Whatever engine you
# want to use to get values
# to your points
cluster = Cluster(pt=grid.Points)

bnd = Bounds(Numbers=flatten(cluster))
panel = Panel(bnd)

gridviewer = GridViewer(
    Grids=grid.Grids,
    Results=cluster,
    Gradient=gradient_2,
    Range="20 to 60",
    MinColor=ColourSwatch(SwatchColor=RGB(54, 111, 255)),
    MaxColor=ColourSwatch(SwatchColor=RGB(152, 214, 250)),
    StepSize=Slider(4, range=4..15),
    Steps=1,
    caps=True)  # -> ColoredMesh, LayeredMesh, Curves, Planes, TempMeshes

grid_2 = Grid(
    Geometry=move_2.Geometry,
    GridSize_m=Slider(10, range=10..50),
    VerticalOffset_m=Slider(8, range=0..10),
    EdgeOffset_m=Slider(4, range=0..10),
    IsoCurves=Toggle(True),
    PerfectSquares=True)  # -> Grids, Mesh, Points
gradient_3 = Gradient(LowerLimit=0, UpperLimit=1, Parameter=1, stops=[0: RGB(0, 128, 0), 0.5: RGB(255, 255, 0), 1: RGB(255, 0, 0)])

# ----
# Whatever engine you
# want to use to get values
# to your points
cluster_2 = Cluster(pt=grid_2.Points)

gridviewer_2 = GridViewer(
    Grids=grid_2.Grids,
    Results=cluster_2,
    Gradient=gradient_3,
    port=RGB(128, 0, 128),
    port_2=RGB(255, 192, 203),
    StepSize=Slider(32, range=10..50),
    Steps=1,
    caps=False)  # -> ColoredMesh, LayeredMesh, Curves, Planes, TempMeshes

grid_3 = Grid(
    Geometry=geo,
    GridSize_m=Slider(15, range=10..50),
    VerticalOffset_m=Slider(8, range=0..10),
    EdgeOffset_m=Slider(4, range=0..10),
    IsoCurves=Toggle(False),
    PerfectSquares=True)  # -> Grids, Mesh, Points

# ----
# Whatever engine you
# want to use to get values
# to your points
cluster_3 = Cluster(pt=grid_3.Points)

gridviewer_3 = GridViewer(Grids=grid_3.Grids, Results=cluster_3, port=RGB(128, 0, 128), port_2=RGB(255, 192, 203), StepSize=1, Steps=1, caps=False)  # -> ColoredMesh, LayeredMesh, Curves, Planes, TempMeshes

# ==== cluster Cluster
pt = ClusterInput()
pt_2 = Point(pt)
avr = Average(Input=pt_2)
dist = Distance(PointA=pt_2, PointB=avr)
D = ClusterOutput(dist)
